vi "Handle IO Data.gviweb"   [G Web Development Software 22.3.0]
inputs:
  "Steps Status in": "Step Status.gtype"[], required
  "Data from ui": f64[], required
  "Test Sequence Data in": f64[][], required
outputs:
  "Steps Status out": "Step Status.gtype"[]
  "Test Sequence Data out": f64[][]
types:
  "Step Result.gtype" = enum{"Pass", "Fail", "Canceled"}
  "Step Status.gtype" = cluster{"Progress": f64, "Result": "Step Result.gtype", "Complete": bool}
uses:
  WebApp::Test Hardware Values.gviweb
diagram:
  Build Array($"Test Sequence Data in", $"Data from ui") -> w1
  $"Test Sequence Data out" <- w1
  # extract progress/ status data
  Delete From Array(inArray=$"Data from ui", index0=0) -> (outArray=w2, deleted=w3)
  Array Size(array=$"Steps Status in") -> (size(s)=w4)
  Decrement(x=w4) -> w5
  Array Index(array=$"Steps Status in") -> (out0[w5]=w6)
  case (w3) {
    frame -2, -1 {
      # force status bar to show full
      w7 = w6
      w8 = 1
      w9 = TRUE
    }
    frame Default {
      Property Node(instance in=w6) -> ("Result"=w10, instance out=w11)
      Array Index(array=w2) -> (out0[_]=w12, out1[_]=w13)
      call "Test Hardware Values.gviweb"(Output to DUT=w12, Input from DUT=w13) -> (Pass=w14)
      case (w10) {
        frame "Pass", Default {
          w16 = "Pass"  # Step Result
          w17 = "Fail"  # Step Result
          Select(s=w14, t=w16, f=w17) -> w15
        }
        frame "Fail" {
          w15 = w10
        }
        frame "Canceled" {
          w15 = w10
        }
      }
      Property Node(instance in=w11, "Result"=w15) -> (instance out=w7)
      w8 = w3
      w9 = default
    }
  }
  Property Node(instance in=w7, "Progress"=w8, "Complete"=w9) -> (instance out=w18)
  Replace Array Subset(inArray=$"Steps Status in", index=w5, new=w18) -> w19
  case (w3) {
    frame Default {
      w20 = w19
    }
    frame -1 {
      Property Node(instance in="Step Status.gtype" {all zero or empty}, "Progress"=0) -> (instance out=w21)
      # new step
      Build Array(w19, w21) -> w20
    }
  }
  $"Steps Status out" <- w20
