vi "Test Hardware Values.gviweb"   [G Web Development Software 22.3.0]
inputs:
  "Target": f64
  "Actual": f64
outputs:
  "Pass": bool
uses:
  WebApp::support::globals.gviweb
diagram:
  disable {
    frame Disabled {
      # #Integrate_Hardware - create hardware specific evaluation here
    }
    frame Enabled {
      call "globals.gviweb"() -> (Globals=w2)
      Property Node(instance in=w2) -> ("Pass Tolerance (%)"=w3)
      # Actual within +/- tolerance of target?
      Divide(x=w3, y=100) -> w4
      Multiply(w4, $Target) -> w5
      Add(w5, $Target) -> w6
      Subtract(x=$Target, y=w5) -> w7
      In Range And Coerce(lower limit=w7, upper limit=w6, x=$Actual) -> (In Range?=w8)
      Is Equal To 0(x=$Target) -> w9
      # if both values zero, in rage function above returns false
      Is Equal To 0(x=$Actual) -> w10
      Logical And(w9, w10) -> w11
      Logical Or(w8, w11) -> w1
    }
  }
  $Pass <- w1
