vi "Update Program Status.gviweb"   [G Web Development Software 22.3.0]
inputs:
  "resulting string": string
  "Message Queues": Queue<"Message Cluster.gtype">[]
  "Input": error
outputs:
  "error out": error
types:
  "Message Cluster.gtype" = cluster{"Message": string, "Message Data": variant}
uses:
  WebApp::support::Message Queue::Enqueue Message (Single).gvi
diagram:
  Array Index(array=$"Message Queues") -> (out0["UI"]=w1)
  call "Enqueue Message (Single).gvi"(message queue in=w1, message="Update Program Status", message data=$"resulting string", error in=$Input) -> (error out=w2)
  $"error out" <- w2
