vi "Handle Data Remaining in Queue.gviweb"   [G Web Development Software 22.3.0]
inputs:
  "Input_3": "Graph reference"[][]
  "Input_2": "ArrayViewer reference"
  "Input_4": Queue<f64[]>
  "Input_5": i32
  "Input": f64[][]
  "Input_6": "Step Status.gtype"[]
  "Input_7": error
outputs:
  "Output": i32
  "Output_3": f64[][]
  "Output_4": "Step Status.gtype"[]
  "Output_2": error
types:
  "Step Result.gtype" = enum{"Pass", "Fail", "Canceled"}
  "Step Status.gtype" = cluster{"Progress": f64, "Result": "Step Result.gtype", "Complete": bool}
uses:
  WebApp::UI::IO Data::Receive IO Data.gviweb
  WebApp::UI::Prep Step Staus for Display.gviweb
diagram:
  call "Receive IO Data.gviweb"(Test data in=$Input, Steps status in=$Input_6, Step Index in=$Input_5, error in=$Input_7, IO Data Queue=$Input_4) -> (Test data out=w1, Steps status out=w2, Step Index out=w3, error out=w4, Test Data for Graph=w5)
  $Output <- w3
  $Output_3 <- w1
  $Output_4 <- w2
  call "Prep Step Staus for Display.gviweb"(Steps status out=w2) -> (Step Status=w6)
  Property Node(instance in=$Input_2, "Value"=w6, error in=w4) -> (error out=w7)
  Property Node(instance in=$Input_3, "Value"=w5, error in=w7) -> (error out=w8)
  $Output_2 <- w8
