vi "Receive IO Data.gviweb"   [G Web Development Software 22.3.0]
inputs:
  "IO Data Queue": Queue<f64[]>, required
  "Steps status in": "Step Status.gtype"[], required
  "Test data in": f64[][], required
  "error in": error
  "Step Index in": i32, required
outputs:
  "Test Data for Graph": f64[][]
  "number elements in queue - seen UI": i32
  "Steps status out": "Step Status.gtype"[]
  "error out": error
  "Test data out": f64[][]
  "Step Index out": i32
types:
  "Step Result.gtype" = enum{"Pass", "Fail", "Canceled"}
  "Step Status.gtype" = cluster{"Progress": f64, "Result": "Step Result.gtype", "Complete": bool}
uses:
  WebApp::UI::IO Data::Handle IO Data.gviweb
diagram:
  Get Queue Status(error in=$"error in", queue=$"IO Data Queue") -> (# elements in queue=w1, error out=w2, queue out=w3)
  $"number elements in queue - seen UI" <- w1
  s1 = $"Test data in"  # shift register
  s2 = $"Steps status in"  # shift register
  s3 = w2  # shift register
  s4 = $"Step Index in"  # shift register
  for (N = w1) {
    Dequeue Element(error in=s3, queue=w3) -> (element=w4, error out=w5)
    call "Handle IO Data.gviweb"(Test Sequence Data in=s1, Steps Status in=s2, Data from ui=w4, Step Index in=s4) -> (Test Sequence Data out=w6, Steps Status out=w7, Step Index out=w8)
    next s1 = w6
    next s2 = w7
    next s3 = w5
    next s4 = w8
  }
  $"Step Index out" <- s4
  $"Steps status out" <- s2
  $"Test data out" <- s1
  Array Size(array=s1) -> (size(s)=w9)
  Array Index(array=w9) -> (out0[_]=w10)
  s5 = s1  # shift register
  for (N = w10) {
    Array Index(array=s5) -> (out0[_, 0]=w11)
    Array Max And Min(array=w11) -> (min index(es)=w12, min value=w13)
    Is Less Than 0(x=w13) -> w14
    # messages are encoded as negative numbers
    # their packets should be removed before data is graphed
    case (w14) {
      frame False {
        w15 = TRUE
        w16 = s5
      }
      frame True {
        Delete From Array(inArray=s5, index0=w12) -> w16
        w15 = default
      }
    }
    next s5 = w16
    stop if w15
  }
  # excludes time elapsed/ status data
  # excludes evaluation results
  # row 1: target
  # row 2: actual
  Array Subset(array=s5, index1=1, length1=2) -> w17
  Transpose 2D Array(2D array=w17) -> (transposed array=w18)
  $"Test Data for Graph" <- w18
  $"error out" <- s3
