vi "Prep Step Staus for Display.gviweb"   [G Web Development Software 22.3.0]
inputs:
  "Steps status out": "Step Status.gtype"[], required
outputs:
  "Step Status": T1[]
types:
  "Step Result.gtype" = enum{"Pass", "Fail", "Canceled"}
  "Step Status.gtype" = cluster{"Progress": f64, "Result": "Step Result.gtype", "Complete": bool}
  "Color.gtype" = u32
  T1 = cluster{"Progress": f64, "Result": "Color.gtype"}
uses:
  WebApp::UI::Get Result Color.gviweb
diagram:
  for {
    w1 = each element of $"Steps status out"
    Property Node(instance in=w1) -> ("Progress"=w3, "Result"=w4, "Complete"=w5)
    case (w5) {
      frame False, Default {
        case (w4) {
          frame "Canceled" {
            call "Get Result Color.gviweb"(Input=w4) -> (Output=w6)
          }
          frame Default {
            w6 = 4294967295
          }
        }
      }
      frame True {
        call "Get Result Color.gviweb"(Input=w4) -> (Output=w6)
      }
    }
    Build Cluster(w3, w6) -> w7
    append w7 to w2
  }
  $"Step Status" <- w2
