vi "Validate Test Sequence.gviweb"   [G Web Development Software 22.3.0]
inputs:
  "Test Sequence Reference": "ArrayViewer reference", required
  "UI Queue": Queue<"Message Cluster.gtype">
  "data": "Test Step Data.gtype"[]
  "error in": error
outputs:
  "Error out": error
types:
  "Waveforms.gtype" = enum{"Constant", "Sawtooth", "Sinusoid"}
  "Waveform Data.gtype" = cluster{"Waveform": "Waveforms.gtype", "Amplitude": f64, "Frequency": f64}
  "Test Step Data.gtype" = cluster{"Duration (s)": f64, "Waveform Data": "Waveform Data.gtype", "Fault Probability": f64}
  "Message Cluster.gtype" = cluster{"Message": string, "Message Data": variant}
uses:
  WebApp::support::Message Queue::Enqueue Message (Single).gvi
diagram:
  s1 = FALSE  # shift register
  for {
    w1 = each element of $data
    Property Node(instance in=w1) -> ("Waveform Data:Waveform"=w3, instance out=w4)
    case (w3) {
      frame "Constant" {
        w5 = w4
        w6 = s1
      }
      frame Default {
        Property Node(instance in=w4) -> ("Waveform Data:Frequency"=w7, instance out=w8)
        Is Equal To 0(x=w7) -> w9
        case (w9) {
          frame False {
            w6 = s1
            w5 = w8
          }
          frame True {
            Property Node(instance in=w8, "Waveform Data:Frequency"=1) -> (instance out=w5)
            w6 = TRUE
          }
        }
      }
    }
    append w5 to w2
    next s1 = w6
  }
  case (s1) {
    frame False, Default {
      w10 = $"error in"
    }
    frame True {
      w11 = """-------------------------
Frequency value of non-constant waveforms must be non-zero. Coerced to 1.
-------------------------"""
      Property Node(instance in=$"Test Sequence Reference", "Value"=w2, error in=$"error in") -> (error out=w12)
      call "Enqueue Message (Single).gvi"(message queue in=$"UI Queue", message="Update Status", message data=w11, error in=w12) -> (error out=w10)
    }
  }
  $"Error out" <- w10
