vi "index.gviweb"   [G Web Development Software 22.3.0]
panel controls:
  "Exit (development only)": bool
  "Test Start": bool
  "Test Steps": T3[]
  "Cancel": bool
panel indicators:
  "Test Duration (s)": f64
  "Step Status": T1[]
  "Program Log": string
  "Program Status": string
  "Initialized": bool
  "Finalized": bool
  "Graph": f64[][]
  "Result": bool
types:
  "Color.gtype" = u32
  T1 = cluster{"Progress": f64, "Result": "Color.gtype"}
  T2 = cluster{"Stimulus": enum{"Constant", "Sawtooth", "Sinusoid"}, "Amplitude": f64, "Frequency": f64}
  T3 = cluster{"Duration (s)": f64, "Waveform Data": T2, "Fault Probability": f64}
  "Step Result.gtype" = enum{"Pass", "Fail", "Canceled"}
  "Step Status.gtype" = cluster{"Progress": f64, "Result": "Step Result.gtype", "Complete": bool}
  "Waveforms.gtype" = enum{"Constant", "Sawtooth", "Sinusoid"}
  "Waveform Data.gtype" = cluster{"Waveform": "Waveforms.gtype", "Amplitude": f64, "Frequency": f64}
  "Test Step Data.gtype" = cluster{"Duration (s)": f64, "Waveform Data": "Waveform Data.gtype", "Fault Probability": f64}
  "IO Data.gtype" = cluster{"Waveform": "Waveforms.gtype", "Duration (s)": f64, "Start Time": timestamp, "Time Factor": f64, "Adjusted Amplitude": f64, "New Wave": bool, "Wave Active": bool, "Fault start time": f64}
  "Manager State.gtype" = enum{"Idle", "Initialize", "Execute", "Finalize", "Cancel", "Error"}
  "Message Queue Names.gtype" = enum{"Manager", "UI", "IO"}
  "Step Data.gtype" = cluster{"Message Queue": "Message Queue Names.gtype", "Action": string}
  "Sequence.gtype" = cluster{"Manager State": "Manager State.gtype", "Steps": "Step Data.gtype"[]}
  "Manager Data.gtype" = cluster{"Current State": "Manager State.gtype", "Current Step": "Step Data.gtype", "Remaining Steps": "Step Data.gtype"[], "Remaining Sequences": "Sequence.gtype"[], "Current Instruction": string}
  "Error Data.gtype" = cluster{"Error Origin": "Message Queue Names.gtype", "Error In": error}
uses:
  WebApp::support::Message Queue::Create All Message Queues.gvi
  WebApp::support::Message Queue::Dequeue Message.gvi
  WebApp::UI::Define Preset Test Sequence.gviweb
  WebApp::UI::Prep Step Staus for Display.gviweb
  WebApp::UI::Calculate Test Duration.gviweb
  WebApp::UI::Validate Test Sequence.gviweb
  WebApp::program instructions::Report Step Complete.gviweb
  WebApp::UI::IO Data::Handle Data Remaining in Queue.gviweb
  WebApp::UI::Get Result Color.gviweb
  WebApp::UI::IO Data::Receive IO Data.gviweb
  WebApp::support::globals.gviweb
  WebApp::support::Generate Undefined Message Error.gviweb
  WebApp::support::Handle Error.gviweb
  WebApp::IO::Handle Next Waveform.gviweb
  WebApp::IO::Generate Waveform.gviweb
  WebApp::IO::Handle Hardware IO.gviweb
  WebApp::development::Check Test Sequence Complete.gviweb
  WebApp::IO::Calculate Target Value.gviweb
  WebApp::program instructions::Define Program Instructions.gviweb
  WebApp::support::Message Queue::Enqueue Message (Single).gvi
  WebApp::UI::Messages::Append Log Text.gviweb
  WebApp::program instructions::Handle Next Sequence.gviweb
  WebApp::program instructions::Handle Next Step.gviweb
  NI::G Core::Error::Build Error Cluster.gvi
  WebApp::UI::Messages::Send Sequence Complete UI Updates.gviweb
  WebApp::UI::Messages::Update Program Status.gviweb
  WebApp::support::Error Handler - Event Handling Loop.gvi
diagram:
  # #development
  # #build
  Property Node(instance in=reference to "Exit (development only)", "Visible"=FALSE) -> (error out=w1)
  w2 = bool FALSE  # Stop Event
  Create User Event[EventName="Stop Event"](error in=w1, user event data type=w2) -> (error out=w3, user event out=w4)
  Obtain Queue(element data type=f64[] [], name="IO data") -> (error out=w5, queue out=w6)
  w7 = ["Manager", "UI", "IO"]  # Queue List
  # #feature_list
  # Hardware fault
  # 	be able to clear error with corresponding case in IO
  # 	handle during initialize or execute
  # Abort
  # Pause
  # Pass initial instruction data to individual steps
  # Display test history/ data
  # Select between historical test data for display
  # 	Historical analysis/ comparison
  # Splining/ smooth transitions between waveforms
  # 	Force sawtooth to return to 0 before waveform transition?
  # Unit tests
  # Check for empty test sequence
  Array Size(array=w7) -> (size(s)=w8)
  call "Create All Message Queues.gvi"(Loop Count=w8, error in=w3) -> (Message Queues=w9, error out=w10)
  Array Index(array=w9) -> (out0["Manager"]=w11, out1["UI"]=w12)
  Merge Errors(w10, w5) -> (error out=w13)
  s1 = uninitialised  # shift register
  s2 = uninitialised  # shift register
  s3 = uninitialised  # shift register
  s4 = uninitialised  # shift register
  s5 = uninitialised  # shift register
  s6 = uninitialised  # shift register
  while {
    call "Dequeue Message.gvi"(message queue in=w12, timeout in milliseconds=s2, error in=w13) -> (timed out?=w14, message queue out=w15, message=w16, message data=w17, error out=w18)
    # UI Update Loop
    # s6: Step Index
    # s5: Test Steps
    # s2: Dequeue Timeout
    case (w16) ignore case {  # Message Cases
      frame "SW Init" {
        Property Node(instance in=reference to "Result", "Value"=FALSE, "Text"=[" ", " "])
        Property Node(instance in=reference to "Initialized", "Value"=FALSE)
        Property Node(instance in=reference to "Finalized", "Value"=FALSE)
        Property Node(instance in=reference to "Finalized", "Value"=FALSE)
        Property Node(instance in=reference to "Test Steps", "Disabled"=FALSE)
        Property Node(instance in=reference to "Initialized", "Value"=FALSE, error in=w18) -> (error out=w27, instance out=w28)
        Property Node(instance in=reference to "Program Status", "Value"="Idle", error in=w18) -> (error out=w29, instance out=w30)
        Property Node(instance in=reference to "Program Log", "Value"="", error in=w18) -> (error out=w31, instance out=w32)
        Build Array(w28, w30, w32) -> w33
        Merge Errors(w27, w29, w31) -> (error out=w34)
        s7 = w34  # shift register
        for {
          w35 = each element of w33
          Close Reference(error in=s7, reference=w35) -> (error out=w36)
          next s7 = w36
        }
        call "Define Preset Test Sequence.gviweb"() -> (Preset Test Sequence=w37)
        Array Size(array=w37) -> (size(s)=w25)
        Initialize Array(element="Step Status.gtype" {all zero or empty}, size=w25) -> w24
        call "Prep Step Staus for Display.gviweb"(Steps status out=w24) -> (Step Status=w38)
        Property Node(instance in=reference to "Step Status", "Value"=w38)
        call "Calculate Test Duration.gviweb"(Test Sequences=w37) -> (Total Duration (s)=w39)
        Property Node(instance in=reference to "Test Duration (s)", "Value"=w39)
        Property Node(instance in=reference to "Test Steps", "Value"=w37) -> (error out=w40)
        call "Validate Test Sequence.gviweb"(Test Sequence Reference=reference to "Test Steps", UI Queue=w15, data=w37, error in=w40)
        w19 = s7
        w20 = default
        w21 = ""
        w22 = -1
        w23 = f64[][] []
        w26 = 0
      }
      frame "Handle Test Change" {
        Variant To Data(error in (no error)=w18, type="Test Step Data.gtype"[] [], variant=w17) -> (data=w41, error out=w42)
        Array Size(array=w41) -> (size(s)=w25)
        call "Calculate Test Duration.gviweb"(Test Sequences=w41) -> (Total Duration (s)=w43)
        $"Test Duration (s)" <- w43
        call "Validate Test Sequence.gviweb"(Test Sequence Reference=reference to "Test Steps", UI Queue=w15, data=w41, error in=w42) -> (Error out=w19)
        w20 = default
        w21 = s1
        w22 = s2
        w23 = s3
        w24 = s4
        w26 = s6
      }
      frame "Execute" {
        # start polling to process data from IO loop
        call "Report Step Complete.gviweb"(Manager Queue=w11, This Queue Name="UI", Step Name=w16, Input_3=w18) -> (Output_2=w19)
        w20 = default
        w21 = s1
        w22 = 0
        w23 = s3
        w24 = s4
        w25 = s5
        w26 = s6
      }
      frame "Update Status" {
        Variant To Data(error in (no error)=w18, type=string "", variant=w17) -> (data=w44, error out=w19)
        Format Into String(formatString="%s\n%s", s1, w44) -> w21
        $"Program Log" <- w21
        w20 = default
        w22 = s2
        w23 = s3
        w24 = s4
        w25 = s5
        w26 = s6
      }
      frame "Update Program Status" {
        Variant To Data(error in (no error)=w18, type=w16, variant=w17) -> (data=w45, error out=w19)
        $"Program Status" <- w45
        w20 = default
        w21 = s1
        w22 = s2
        w23 = s3
        w24 = s4
        w25 = s5
        w26 = s6
      }
      frame "Initialize Complete" {
        $Initialized <- TRUE
        w19 = w18
        w20 = default
        w21 = s1
        w22 = s2
        w23 = s3
        w24 = s4
        w25 = s5
        w26 = s6
      }
      frame "Initialize" {
        Property Node(instance in=reference to "Result", "Value"=FALSE)
        Property Node(instance in=reference to "Test Steps", "Disabled"=TRUE)
        Property Node(instance in=reference to "Initialized", "Value"=FALSE)
        Property Node(instance in=reference to "Finalized", "Value"=FALSE)
        # Enure at least 1 step is present
        Max And Min(x=s5, y=1) -> (max(x,y)=w46: i32)
        Initialize Array(element="Step Status.gtype" {all zero or empty}, size=w46) -> w24
        call "Prep Step Staus for Display.gviweb"(Steps status out=w24) -> (Step Status=w47)
        Property Node(instance in=reference to "Step Status", "Value"=w47, error in=w18) -> (error out=w48)
        call "Report Step Complete.gviweb"(Manager Queue=w11, This Queue Name="UI", Step Name=w16, Input_3=w48) -> (Output_2=w19)
        w20 = default
        w21 = s1
        w22 = s2
        w23 = f64[][] []
        w25 = s5
        w26 = 0
      }
      frame "Execute Complete" {
        # Handle any data remaining in queue
        call "Handle Data Remaining in Queue.gviweb"(Input_3=reference to "Graph", Input_2=reference to "Step Status", Input_4=w6, Input_5=s6, Input=s3, Input_6=s4, Input_7=w18) -> (Output=w26, Output_3=w23, Output_4=w24, Output_2=w19)
        w20 = default
        w21 = s1
        w22 = s2
        w25 = s5
      }
      frame "Finalize" {
        s8 = "Pass"  # shift register
        for {
          w49 = each element of s4
          Property Node(instance in=w49) -> ("Result"=w50)
          case (s8) {
            frame "Pass", Default {
              w51 = w50
            }
            frame "Fail" {
              case (w50) {
                frame Default {
                  w51 = w50
                }
                frame "Pass" {
                  w51 = s8
                }
              }
            }
            frame "Canceled" {
              w52 = "Canceled"  # Step Result
              w51 = w52
            }
          }
          next s8 = w51
        }
        call "Get Result Color.gviweb"(Input=s8) -> (Output=w53)
        Format Into String(formatString="%s", s8) -> w54
        Build Array(w54) -> w55
        # stop polling
        Property Node(instance in=reference to "Result", "TrueColor"=w53, "Text"=w55)
        $Result <- TRUE
        Property Node(instance in=reference to "Test Steps", "Disabled"=TRUE)
        call "Report Step Complete.gviweb"(Manager Queue=w11, This Queue Name="UI", Step Name=w16, Input_3=w18) -> (Output_2=w19)
        w20 = default
        w21 = s1
        w22 = -1
        w23 = s3
        w24 = s4
        w25 = s5
        w26 = s6
      }
      frame "Finalize Complete" {
        $Finalized <- TRUE
        Property Node(instance in=reference to "Test Steps", "Disabled"=FALSE)
        w19 = w18
        w20 = default
        w21 = s1
        w22 = s2
        w23 = s3
        w24 = s4
        w25 = s5
        w26 = s6
      }
      frame "Cancel" {
        Array Index(array=s4) -> (out0[s6]=w56)
        Property Node(instance in=w56, "Result"="Canceled") -> (instance out=w57)
        Replace Array Subset(inArray=s4, index=s6, new=w57) -> w58
        call "Handle Data Remaining in Queue.gviweb"(Input_3=reference to "Graph", Input_2=reference to "Step Status", Input_4=w6, Input_5=s6, Input=s3, Input_6=w58, Input_7=w18) -> (Output=w26, Output_3=w23, Output_4=w24, Output_2=w59)
        call "Report Step Complete.gviweb"(Manager Queue=w11, This Queue Name="UI", Step Name=w16, Input_3=w59) -> (Output_2=w19)
        w20 = default
        w21 = s1
        w22 = s2
        w25 = s5
      }
      frame "Cancel Complete" {
        w19 = w18
        w20 = default
        w21 = s1
        w22 = s2
        w23 = s3
        w24 = s4
        w25 = s5
        w26 = s6
      }
      frame "Exit" {
        Release Queue(queue=w15) -> (error out=w60)
        Release Queue(queue=w6) -> (error out=w61)
        Merge Errors(w18, w60, w61) -> (error out=w19)
        w20 = TRUE
        w21 = s1
        w22 = s2
        w23 = s3
        w24 = s4
        w25 = s5
        w26 = s6
      }
      frame Default {
        case (w14) {
          frame True {
            call "Receive IO Data.gviweb"(Test data in=s3, Steps status in=s4, Step Index in=s6, error in=w18, IO Data Queue=w6) -> (Test data out=w23, Steps status out=w24, Step Index out=w26, error out=w19, Test Data for Graph=w62)
            $Graph <- w62
            call "Prep Step Staus for Display.gviweb"(Steps status out=w24) -> (Step Status=w63)
            $"Step Status" <- w63
            call "globals.gviweb"() -> (Globals=w64)
            Property Node(instance in=w64) -> ("UI Polling Period (ms)"=w65)
            Wait(time to wait=w65)
          }
          frame False {
            call "Generate Undefined Message Error.gviweb"(Queue Name="UI", Message=w16, Error in=w18) -> (Error out=w19)
            w23 = s3
            w24 = s4
            w26 = s6
          }
        }
        w20 = default
        w21 = s1
        w22 = s2
        w25 = s5
      }
    }
    call "Handle Error.gviweb"(Input=w11, Input_2="UI", Output_2=w19) -> (Output_3=w66)
    next s1 = w21
    next s2 = w22
    next s3 = w23
    next s4 = w24
    next s5 = w25
    next s6 = w26
    stop if w20
  }
  call "globals.gviweb"() -> (Globals=w67)
  Property Node(instance in=w67) -> ("IO Loop Period (ms)"=w68)
  Array Index(array=w9) -> (out0["Manager"]=w69, out1["IO"]=w70)
  s9 = uninitialised  # shift register
  s10 = uninitialised  # shift register
  while {
    call "Dequeue Message.gvi"(message queue in=w70, timeout in milliseconds=0, error in=w10) -> (timed out?=w71, message queue out=w72, message=w73, message data=w74, error out=w75)
    # UI Update Loop
    case (w73) ignore case {  # Message Cases
      frame "SW Init" {
        w76 = w75
        w77 = default
        w78 = s9
        w79 = "IO Data.gtype" {all zero or empty}
      }
      frame "Initialize" {
        disable {
          frame Disabled {
            # #Integrate_Hardware
            # Hardware uninitialization goes here
            w80 = w75
          }
          frame Enabled {
            call "globals.gviweb"() -> (Globals=w81)
            Property Node(instance in=w81) -> ("Hardware Initialize Duration (s)"=w82)
            # #debug
            Multiply(w82, 1000) -> w83
            Wait(time to wait=w83)
            w80 = w75
          }
        }
        call "Report Step Complete.gviweb"(Manager Queue=w69, This Queue Name="IO", Step Name=w73, Input_3=w80) -> (Output_2=w76)
        w77 = default
        w78 = s9
        w79 = s10
      }
      frame "Finalize" {
        disable {
          frame Disabled {
            # #Integrate_Hardware
            # Hardware uninitialization goes here
            w84 = w75
          }
          frame Enabled {
            call "globals.gviweb"() -> (Globals=w85)
            Property Node(instance in=w85) -> ("Hardware Finalize Duration (s)"=w86)
            # #debug
            Multiply(w86, 1000) -> w87
            Wait(time to wait=w87)
            w84 = w75
          }
        }
        call "Report Step Complete.gviweb"(Manager Queue=w69, This Queue Name="IO", Step Name=w73, Input_3=w84) -> (Output_2=w76)
        w77 = default
        w78 = s9
        w79 = s10
      }
      frame "Execute" {
        # #todo move some of this functionality to initialization and check if test sequence is empty
        # report empty back to manager
        call "Handle Next Waveform.gviweb"(Test Sequence in=$"Test Steps", IO Data In=s10) -> (Test Sequence out=w78, IO Data out=w79)
        w76 = w75
        w77 = default
      }
      frame "Cancel" {
        sequence {
          frame 0 {
            # Stop IO
            Property Node(instance in=s10, "Wave Active"=FALSE) -> (instance out=w79)
          }
        }
        call "Report Step Complete.gviweb"(Manager Queue=w69, This Queue Name="IO", Step Name=w73, Input_3=w75) -> (Output_2=w76)
        w77 = default
        w78 = s9
      }
      frame "Exit" {
        Release Queue(queue=w72) -> (error out=w88)
        Merge Errors(w75, w88) -> (error out=w76)
        w77 = TRUE
        w78 = s9
        w79 = s10
      }
      frame Default {
        case (w71) {
          frame True {
            Property Node(instance in=s10) -> ("Wave Active"=w89, instance out=w90)
            # No message -> handle output
            case (w89) {
              frame False, Default {
                w79 = w90
                w76 = w75
                w78 = s9
              }
              frame True {
                Property Node(instance in=w90) -> ("New Wave"=w91, instance out=w92)
                case (w91) {
                  frame False, Default {
                    w93 = w92
                  }
                  frame True {
                    Get Current Time() -> (current time=w94)
                    # only save init timestamp at wave start
                    Property Node(instance in=w92, "Start Time"=w94, "New Wave"=FALSE) -> (instance out=w93)
                  }
                }
                call "Generate Waveform.gviweb"(IO Data=w93) -> (Time Elapsed=w95, IO data out=w96, Wave Value=w97, Fraction Complete=w98)
                call "Handle Hardware IO.gviweb"(IO data in=w96, Hardware output=w97, Time Elapsed=w95) -> (IO data out=w99, Hardware input=w100)
                call "Check Test Sequence Complete.gviweb"(This Queue Name="IO", Test Sequence in=s9, IO data in=w99, Fraction Complete=w98, Manager Queue=w69) -> (Test Sequence out=w78, IO data out=w79, Fraction Complete (includes messages)=w101)
                call "Calculate Target Value.gviweb"(Wave Value=w97) -> (Target=w102)
                Build Array(w101, w102, w100) -> w103
                Enqueue Element(element=w103, error in=w75, queue=w6) -> (error out=w76)
              }
            }
          }
          frame False {
            # Received message
            call "Generate Undefined Message Error.gviweb"(Queue Name="IO", Message=w73, Error in=w75) -> (Error out=w76)
            w79 = s10
            w78 = s9
          }
        }
        w77 = default
      }
    }
    call "Handle Error.gviweb"(Input=w69, Input_2="IO", Output_2=w76) -> (Output_3=w104)
    Wait(time to wait=w68)
    next s9 = w78
    next s10 = w79
    stop if w77
  }
  Array Index(array=w9) -> (out0["Manager"]=w105)
  call "Define Program Instructions.gviweb"() -> (Instructions=w106, Instruction names=w107)
  s11 = uninitialised  # shift register
  while {
    # w9: Message Queues
    call "Dequeue Message.gvi"(message queue in=w105, error in=w10) -> (message queue out=w108, message=w109, message data=w110, error out=w111)
    # "Manager": Manager Queue Name
    # w4: Stop Event
    # s11: Manager Data
    # w106: Instructions
    # w107: Instruction Names
    case (w109) ignore case {  # Message Cases
      frame "SW Init" {
        w112 = w111
        w113 = default
        w114 = "Manager Data.gtype" {all zero or empty}
      }
      frame "Test Sequence Change" {
        Array Index(array=w9) -> (out0["UI"]=w115)
        call "Enqueue Message (Single).gvi"(message queue in=w115, message="Handle Test Change", message data=w110, error in=w111) -> (error out=w112)
        w113 = default
        w114 = s11
      }
      frame "Error" {
        Variant To Data(error in (no error)=w111, type="Error Data.gtype" {all zero or empty}, variant=w110) -> (data=w116, error out=w117)
        Property Node(instance in=w116) -> ("Error Origin"=w118, "Error In"=w119)
        Property Node(instance in=w119) -> ("code"=w120, "source"=w121)
        w122 = "================\nError\n\nAt: %s\n\nCode: %d\n%s\n================"
        Format Into String(formatString=w122, errIn=w117, w118, w120, w121) -> (outString=w123, errOut=w124)
        call "Append Log Text.gviweb"(Message Queues in=w9, Update Tex=w123, Error in=w124) -> (Error out_2=w112)
        w113 = default
        w114 = s11
      }
      frame "Exit Pressed" {
        # #development
        s12 = w111  # shift register
        for {
          w125 = each element of w9
          call "Enqueue Message (Single).gvi"(message queue in=w125, message="Exit", error in=s12) -> (error out=w126)
          next s12 = w126
        }
        w112 = s12
        w113 = default
        w114 = s11
      }
      frame "Exit" {
        Generate User Event(event data=TRUE, user event=w4) -> (error out=w127)
        Release Queue(queue=w108) -> (error out=w128)
        Merge Errors(w128, w127) -> (error out=w112)
        w113 = TRUE
        w114 = s11
      }
      frame Default {
        call "Generate Undefined Message Error.gviweb"(Queue Name="Manager", Message=w109, Error in=w111) -> (Error out=w112)
        w113 = default
        w114 = s11
      }
      frame "Instruction" {
        # w129: Instruction Name
        Variant To Data(error in (no error)=w111, type=w109, variant=w110) -> (data=w129, error out=w130)
        Search 1D Array(1D array=w107, element=w129) -> (index of element=w131)
        case (w131) {
          frame Default {
            Array Index(array=w106) -> (out0[w131]=w132)
            Property Node(instance in=w132) -> ("Init Info:Valid Starts"=w133, instance out=w134)
            Property Node(instance in=s11) -> ("Current State"=w135, instance out=w136)
            Search 1D Array(1D array=w133, element=w135) -> (index of element=w137)
            # Message in sequence start list -> ensure in valid start state
            case (w137) {
              frame Default {
                # In valid state for recieved message -> react
                Property Node(instance in=w134) -> ("Sequences"=w138)
                Format Into String(formatString="******************\nStart: %s\n******************", errIn=w130, w129) -> (outString=w139, errOut=w140)
                call "Append Log Text.gviweb"(Message Queues in=w9, Update Tex=w139, Error in=w140) -> (Message Queues out=w141, Error out_2=w142)
                call "Handle Next Sequence.gviweb"(Manager data in=w136, Sequences=w138, error in=w142, Message Queues=w141) -> (manager data out=w143, Sequence Steps=w144, End Instruction=w145, error out=w146, Message Queues out=w147)
                case (w145) {
                  frame True {
                    # #verify - new instruction, but sequences empty
                    w148 = "-------------------------------------\nInstruction Sequences Empty\n-------------------------------------"
                    call "Append Log Text.gviweb"(Message Queues in=w147, Update Tex=w148, Error in=w146) -> (Error out_2=w112)
                    w114 = w143
                  }
                  frame False {
                    Property Node(instance in=w143, "Current Instruction"=w129) -> (instance out=w149)
                    # Start first step in first sequence
                    call "Handle Next Step.gviweb"(Manager Data in=w149, Sequence Steps=w144, Error in=w146, Nessage Queues in=w147) -> (Manager Data out=w114, Error out=w112)
                  }
                }
              }
              frame -1 {
                w150 = """-------------------------------------
Received inavalid message for current status

Invalid Message: %s

State: %s
Currently waiting on: %s
-------------------------------------"""
                Property Node(instance in=w136) -> ("Current State"=w151, "Current Step:Message Queue"=w152)
                Format Into String(formatString=w150, errIn=w130, w129, w151, w152) -> (outString=w153, errOut=w154)
                call "Append Log Text.gviweb"(Message Queues in=w9, Update Tex=w153, Error in=w154) -> (Error out_2=w112)
                w114 = w136
              }
            }
          }
          frame -1 {
            # Instruction name missing from list -> undefined
            Format Into String(formatString="Instruction \"%s\" undefined.", w129) -> w155
            call "Build Error Cluster.gvi"(code=1, description=w155, error in=w130) -> (error out=w112)
            w114 = s11
          }
        }
        w113 = default
      }
      frame "Step Complete" {
        Property Node(instance in=s11) -> ("Current Step"=w156)
        Variant To Data(error in (no error)=w111, type=w156, variant=w110) -> (data=w157, error out=w158)
        Is Equal[ComparisonMode=CompareAggregates](x=w156, y=w157) -> w159
        case (w159) {
          frame False, Default {
            w160 = "Unexpected \"Step Complete\" message \n\nFrom: %s with action %s\nExpected: %s with action %s"
            Property Node(instance in=w157) -> ("Message Queue"=w161, "Action"=w162)
            Property Node(instance in=w156) -> ("Message Queue"=w163, "Action"=w164)
            Format Into String(formatString=w160, w161, w162, w163, w164) -> w165
            call "Append Log Text.gviweb"(Message Queues in=w9, Update Tex=w165, Error in=w158) -> (Error out_2=w112)
            w114 = s11
          }
          frame True {
            # Expected complete message received
            Property Node(instance in=s11) -> ("Remaining Steps"=w166, instance out=w167)
            Array Size(array=w166) -> (size(s)=w168)
            Property Node(instance in=w156) -> ("Message Queue"=w169, "Action"=w170)
            Format Into String(formatString="Completed %s %s", errIn=w158, w169, w170) -> (outString=w171, errOut=w172)
            call "Append Log Text.gviweb"(Message Queues in=w9, Update Tex=w171, Error in=w172) -> (Message Queues out=w173, Error out_2=w174)
            case (w168) {
              frame Default {
                # Steps remaining -> handle next step
                call "Handle Next Step.gviweb"(Manager Data in=w167, Sequence Steps=w166, Error in=w174, Nessage Queues in=w173) -> (Manager Data out=w114, Error out=w112)
              }
              frame 0 {
                Property Node(instance in=w167) -> ("Remaining Sequences"=w175, "Current State"=w176, instance out=w177)
                call "Send Sequence Complete UI Updates.gviweb"(Message queues in=w173, Current State=w176, Error In=w174) -> (Message queues out=w178, Error out=w179)
                call "Handle Next Sequence.gviweb"(Manager data in=w177, Sequences=w175, error in=w179, Message Queues=w178) -> (manager data out=w180, Sequence Steps=w181, End Instruction=w182, error out=w183, Message Queues out=w184)
                Property Node(instance in=w180) -> ("Current State"=w185, instance out=w186)
                # Sequence complete -> handle next sequence if it exists
                Format Into String(formatString="%s", errIn=w183, w185) -> (outString=w187, errOut=w188)
                call "Update Program Status.gviweb"(Message Queues in=w184, Status=w187, Error in=w188) -> (Message Queues out=w189, Error out=w190)
                case (w182) {
                  frame False, Default {
                    # Handle next step of next sequence
                    call "Handle Next Step.gviweb"(Manager Data in=w186, Sequence Steps=w181, Error in=w190, Nessage Queues in=w189) -> (Manager Data out=w114, Error out=w112)
                  }
                  frame True {
                    Property Node(instance in=w186) -> ("Current Instruction"=w191, instance out=w192)
                    # No more sequences -> Instruction complete
                    # prevents confusion of manager possibly waiting on another loop
                    Property Node(instance in=w192, "Current Step:Message Queue"="Manager") -> (instance out=w114)
                    Format Into String(formatString="******************\nComplete: %s\n******************", errIn=w190, w191) -> (outString=w193, errOut=w194)
                    call "Append Log Text.gviweb"(Message Queues in=w189, Update Tex=w193, Error in=w194) -> (Error out_2=w112)
                  }
                }
              }
            }
          }
        }
        w113 = default
      }
    }
    call "Handle Error.gviweb"(Input=w108, Input_2="Manager", Output_2=w112) -> (Output_3=w195)
    next s11 = w114
    stop if w113
  }
  # #todo
  # change status text so instruction, sequence and steps are clearly identifiable
  # 	sequence not to be confused with test sequence (maybe change one to routine?)
  # create/ configure simulation cases/ flags
  # clean up
  # 	UI loop
  # 	IO loop
  # 	save all text log messages in same place
  Register For Events("Stop Event"=w4) -> (event registration refnum out=w196)
  Array Index(array=w9) -> (out0["Manager"]=w197)
  # The framework behind this sequencer operates by handling instructions in a manager loop. Instructions are initiated by sending an "Instruction" message via the manager's queue (marked with ******************) and checked against a list of valid start states.  In each sequence element in the instruction, a manager state name is defined ("____ Start") and the program status is updated upon reaching that element. The sequence steps are then executed sequentially by sending a message to the corresponding loop ("Waiting on ___ to ___..."), with the manager then expecting a response to indicate each step's completion via the Report Step Complete VI ("Completed ___ ___").  This framework allows for easily reconfigurable program execution with the order of execution being defined as structured overview in a single location. Adding additional step types requires simply adding a corresponding step to a desired loop.
  #
  # Note:
  # - The array nested in program sequences contains the individual steps to be executed, each in turn containing a message queue/ loop name and a message defining the action to be completed.
  # - The final emtpy sequence in the array is used to set the final state of the manager.
  # - The UI loop receives a "___ Complete" upon the conclusion of all steps in any given sequence, with the ___ being the state name.
  # - The names of the step messages do not have to match the name of the manager state for that sequence.
  # - Instructions cannot be queued. There can only be one active at a time.
  # - Instruction names, start states and corresponding sequences are defined and stored in the Define Program Instructions VI, being made available to the manager at program start.
  # Run Test Sequence example
  #
  # State: Idle
  #
  # Start Pressed
  #
  # Initialize
  # 	>> To UI ---Initialize
  # 	Waiting on UI
  # 	>> To IO ---Initialize
  # 	Waiting on IO
  # Execute
  # 	>> To UI ---Execute
  # 	Waiting on UI
  # 	>> To IO ---Execute
  # 	Waiting on IO
  # Finalize
  # 	>> To IO ---Finalize
  # 	Waiting on IO
  # 	>> To UI ---Finalize
  # 	Waiting on UI
  # Idle
  s13 = w196  # shift register
  while {
    event (dynamic events = s13) {
      on "Test Start" Value changed {
        call "Enqueue Message (Single).gvi"(message queue in=w197, message="Instruction", message data="Run Test Sequence") -> (message queue out=w200, error out=w199)
        w198 = default
      }
      on "Cancel" Value changed {
        call "Enqueue Message (Single).gvi"(message queue in=w197, message="Instruction", message data="Cancel") -> (message queue out=w200, error out=w199)
        w198 = default
      }
      on "Exit (development only)" Value changed {
        call "Enqueue Message (Single).gvi"(priority message=TRUE, message queue in=w197, message="Exit Pressed") -> (message queue out=w200, error out=w199)
        w198 = default
      }
      on dynamic event 0 {
        # The Message Handling Loop processed an "Exit" message, which fired this event to stop the Event Handling Loop.
        w198 = TRUE
        w199 = default
        w200 = w197
      }
      on "Test Steps" Value changed {
        Event Data() -> ("New Value"=w201)
        To Variant(anything=w201) -> w202
        call "Enqueue Message (Single).gvi"(message queue in=w197, message="Test Sequence Change", message data=w202) -> (message queue out=w200, error out=w199)
        w198 = default
      }
    }
    call "Error Handler - Event Handling Loop.gvi"(message queue in=w200, error in=w199) -> (dup error in=w203)
    stop if w198
  }
  Unregister For Events(error in=w203, event registration refnum=s13) -> (error out=w204)
  Merge Errors(w204, w195, w66, w104) -> (error out=w205)
  Destroy User Event(error in=w205, user event=w4)
