vi "Handle Next Sequence.gviweb"   [G Web Development Software 22.3.0]
inputs:
  "manager data in": "Manager Data.gtype", required
  "Sequences": T2[], required
  "Message Queues": Queue<"Message Cluster.gtype">[], required
  "error in": error
outputs:
  "manager data out": "Manager Data.gtype"
  "Sequence Steps": T1[]
  "Sequences Empty": bool
  "error out": error
types:
  "Manager State.gtype" = enum{"Idle", "Initialize", "Execute", "Finalize"}
  "Message Queue Names.gtype" = enum{"Manager", "UI", "IO"}
  "Step Data.gtype" = cluster{"Message Queue": "Message Queue Names.gtype", "Action": string}
  "Sequence.gtype" = cluster{"Manager State": "Manager State.gtype", "Steps": "Step Data.gtype"[]}
  "Manager Data.gtype" = cluster{"Current State": "Manager State.gtype", "Current Step": "Step Data.gtype", "Remaining Steps": "Step Data.gtype"[], "Remaining Sequences": "Sequence.gtype"[]}
  T1 = cluster{"Message Queue": "Message Queue Names.gtype", "Action": string}
  T2 = cluster{"State": "Manager State.gtype", "Steps": T1[]}
  "Message Cluster.gtype" = cluster{"Message": string, "Message Data": variant}
uses:
  WebApp::UI messages::Append Log Text.gviweb
  WebApp::UI messages::Update Program Status.gviweb
diagram:
  Array Size(array=$Sequences) -> (size(s)=w1)
  case (w1) {
    frame 0 {
      Property Node(instance in=$"manager data in", "Current State"="Idle") -> (instance out=w2)
      w3 = default
      w4 = TRUE
      w5 = $"error in"
    }
    frame Default {
      Delete From Array(inArray=$Sequences, index0=0) -> (outArray=w6, deleted=w7)
      Property Node(instance in=w7) -> ("State"=w8, "Steps"=w3)
      Property Node(instance in=$"manager data in", "Current State"=w8, "Remaining Sequences"=w6) -> (instance out=w2)
      Format Into String(formatString="%s Start", errIn=$"error in", w8) -> (outString=w9, errOut=w10)
      call "Append Log Text.gviweb"(Input=$"Message Queues", resulting string=w9, error out=w10) -> (Output_2=w5)
      w4 = FALSE
    }
  }
  Property Node(instance in=w2) -> ("Current State"=w11, instance out=w12)
  $"manager data out" <- w12
  $"Sequence Steps" <- w3
  $"Sequences Empty" <- w4
  Format Into String(formatString="%s", w11) -> w13
  call "Update Program Status.gviweb"(resulting string=w13, Message Queues=$"Message Queues", Input=w5) -> (error out=w14)
  $"error out" <- w14
